# Grasshopper definition solarAnalysis.gh (Grasshopper 1.0.7)
# plug-ins: BH.UI.Grasshopper

ladybug = Ladybug_Ladybug()  # -> Vviiiiiiiiiizzz; plug-in component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
number_slider = Slider(2, range=0..10)
constructlocation = Ladybug_ConstructLocation(locationName="unknown_Location", latitude=0, longitude=0, timeZone=number_slider, elevation=0)  # -> location; plug-in component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
number_slider_2 = Slider(21, range=0..100)
number_slider_3 = Slider(10, range=0..100)
sunpath = Ladybug_SunPath(
    location=constructlocation,
    hour=number_slider_3,
    day=number_slider_2,
    month=12,
    timeStep=1,
    sunPathScale=Slider(1, range=0..1),
    dailyOrAnnualSunPath=True)  # -> readMe, sunVectors, sunAltitudes, sunAzimuths, port, sunSpheresMesh, sunPathCrvs, compassCrvs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; disabled; plug-in component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
location = Location(
    Latitude=Slider(-90, range=-90..90),
    Longitude=Slider(30, range=-180..180),
    Elevation=0,
    UtcOffset=number_slider,
    Name="Kyiv",
    Component="BH.oM.Environment.Climate.Location")
compute = Compute(Component="{ \"SelectedItem\" : null, \"InputParams\" : [], \"OutputParams\" : [], \"BHoM_Guid\" : \"c66c334e-ae54-4286-9e5b-3dfdc1968812\" }")
spacetime = SpaceTime(
    Location=location,
    Year=Slider(2020, range=0..10000),
    Month=Slider(3, range=0..10),
    Day=number_slider_2,
    Hour=number_slider_3,
    Minute=0,
    Second=0,
    Millisecond=0,
    Component="BH.oM.Environment.Climate.SpaceTime")
cir = Circle(Plane=PlaneXY(0, 0, 0), Radius=1)
dailypath = DailyPath(SpaceTime=spacetime, Component="{ .DailyPath")
mounthpaths = MounthPaths(SpaceTime=spacetime, Component="{ .MounthPaths")
getproperty = GetProperty(PropName="Azimuth", Component="{ .GetProperty")
explode = Explode(Component="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")  # -> Azimuth, Altitude, Sunrise, Sunset, BHoM_Guid, Name, Fragments, Tags, CustomData
panel = Panel(explode.Altitude)
line = LineSDL(Start="0,0,0", Direction=Vector(0, 0, 1), Length=Slider(500, range=0..1000))
